# Grasshopper definition eddy-with animations.gh (Grasshopper 0.9.76)
# plug-ins: Python Interpreter, setFlounderCamera

panel = Panel("""100.3116806323
33.4088509630
63.0069243168
94.8129582716
63.4129812249
42.2420296456
10.4971641141
99.2535728324
25.6902810641
31.7261429651
4.46976219046
-40.7068830257
47.8124119145
69.1646233011""")
panel_2 = Panel("""1
0.5
0.5
0.5
0.75
0.5
0.5
0.5
1
0.5
0.5
0
0
0.75""")
panel_3 = Panel("""100
100
100
50
100
100
100
50
100
100
100
50
100
100
50
100""")
# Stadiums
pt = Point([<point referenced from the Rhino model> x14])

# ----
# Site Surface
# Site Boundary
srf = Surface(reparameterize(<surface referenced from the Rhino model>))
crv = Curve(<curve referenced from the Rhino model>)

python = PythonScript(eddyinput=pt, gravityinput=panel, N=Slider(100, range=0..100))  # -> out, fieldcollection, pointcollection; inputs eddyinput: list of Point3d, gravityinput: list, N: Int32; disabled
# ---------- python: Python ----------
#=================================#
#============Kanagawa==============#
#=======For Tokyo Studio=====#
#==========Written by Dugy========#
#===========Apr 11th 2017==========#
#==Do not use without permission==#
#=================================#
from math import *
import random
import Rhino.Geometry as rg
import Rhino.Geometry.Vector3d as PVector
import Rhino.Geometry.Point3d as Point 
import Rhino.Geometry.Curve as Curve
import Rhino.Geometry.Line as Line
#=======================#
#Basic Functions
#=======================#
def toplimit(vct,speed):
	if vct.Length <= speed:
		pass
	else:
		vct.Unitize()
		vct = PVector.Multiply(vct,speed)
	return vct

def lowerlimit(vct,speed):
	if vct.Length >= speed:
		pass
	else:
		vct.Unitize()
		vct = PVector.Multiply(vct,speed)
	return vct
#=================================#
#Classes
#=================================#
class Eddy():
	"""provide gravity"""
	def __init__(self, pos_, gravity_, id_):
		self.id = id_
		self.gravity = gravity_
		self.location = pos_
class Flow():
	"""vector field"""
	def __init__(self, pos_, speed_,toplimit_,lowerlimit_, id_):
		self.id = id_
		self.location = pos_
		self.velocity = speed_
		self.toplimit = toplimit_
		self.lowerlimit = lowerlimit_
		self.pointlist = [Point(self.location)]
		self.trail = None
		self.target = PVector(0,0,0)
		self.orient = PVector(0,0,0)
	def gettarget(self,eddies):
		target_2d  = PVector(0,0,0)
		target_z = PVector(0,0,0)
		ratio = 0.5

		for i in range(len(eddies)):   # FOR EVERY EDDY  compute the target force
			vi = PVector.Subtract(eddies[i].location,self.location)

			vi_2d = PVector(vi.X,vi.Y,0)  # planer target
			vi_z = vi #PVector(0,0,vi.Z) # z axis target

			dist_2d = vi_2d.Length
			dist_z = vi_2d.Length

			vi_2d.Unitize()
			vi_2d = PVector.Multiply(vi_2d, float(eddies[i].gravity/pow(dist_2d,1)))
			vi_z.Unitize()
			vi_z = PVector.Multiply(vi_z, float(eddies[i].gravity/(pow(dist_z+10,1))))

			target_2d = PVector.Add(target_2d,vi_2d)
			target_z = PVector.Add(target_z,vi_z)

		#Limit the target length
		target_2d = toplimit(target_2d,self.toplimit)   
		target_2d = lowerlimit(target_2d,self.lowerlimit)
		target_z = toplimit(target_z,self.toplimit*5)
		target_z = lowerlimit(target_z,self.lowerlimit*5)

		self.target = PVector(target_2d.X, target_2d.Y, target_z.Z/2)
	def getorient(self):
		ra = 0.6
		rb = 0.5
		orient_2d = PVector(self.target.X, self.target.Y, 0)   	#the same as target_2d
		orient_z = PVector(0,0,self.target.Z) 		#the same as target_z

		orient_2d.Rotate(1.0*pi, PVector(0,0,1))

		orient_2d = toplimit(orient_2d,self.toplimit)
		orient_2d = lowerlimit(orient_2d,self.lowerlimit)
		#orient_z = toplimit(orient_z,self.toplimit*ra*rb)
		#orient_z = lowerlimit(orient_z,self.lowerlimit*ra*rb)

		self.orient = PVector(orient_2d.X, orient_2d.Y, orient_z.Z)
	def update(self,eddies):
		self.gettarget(eddies)
		self.getorient()
		self.velocity = self.orient
		self.location = PVector.Add(self.location,self.velocity) 
	def drawtrial(self):
		self.pointlist.append(Point(self.location))
		self.trail = Curve.CreateInterpolatedCurve(self.pointlist,3)
	def run(self,eddies):
		self.update(eddies)
		self.drawtrial()
#=================================#
#Parameters
#=================================#
n_eddys = 14
cellsize = 15

xlength = 400
ylength = 400
zlength = 10
#=================================#
#Collections
#=================================#

eddycollection = []
flowcollection = []

#for i in range(n_eddys):
	#eddy_x = random.uniform(0,xlength)
	#eddy_y = random.uniform(0,ylength)
	#eddy_z = random.uniform(0,zlength)
	#eddypos = PVector(eddy_x, eddy_y, eddy_z)
	#eddygravity = random.uniform(2,100)
	#eddycollection.append(Eddy(eddypos,eddygravity,i))
for i in range(len(eddyinput)):
	eddypos = PVector(eddyinput[i].X,eddyinput[i].Y,eddyinput[i].Z)
	eddycollection.append(Eddy(eddypos,gravityinput[i],i))

for i in range(int(xlength/cellsize)+1):
	for j in range(0,int(ylength/cellsize)+1):
		for k in range(0,int(zlength/cellsize)+1):
			flowpos = PVector(float(i*cellsize)+240,float(j*cellsize)+320,float(k*cellsize))
			flowspeed = PVector(0,0,0)
			flowcollection.append(Flow(flowpos,flowspeed,2.0,2.0,[i,j,k]))
#=================================#
#Draw
#=================================#
for i in range(N):
	for particle in flowcollection:
		particle.run(eddycollection)
	#print flowcollection[12].velocity.Length

#=================================#
#Storage Output
#=================================#

fieldcollection = []
#pointcollection = []
for particle in flowcollection:
	fieldcollection.append(particle.trail)
#for eddy in eddycollection:
#	pointcollection.append(Point(eddy.location.X,eddy.location.Y,eddy.location.Z))
# ---------- end python ----------
python_2 = PythonScript(
    sitesrf=srf,
    eddyinput=pt,
    gravityinput=panel,
    orichargeinput=panel_2,
    affrangeinput=panel_3,
    sitecrv=crv,
    N=Slider(41, range=0..100))  # -> out, fieldcollection, pointcollection; inputs sitesrf: Surface, eddyinput: list of Point3d, gravityinput: list, orichargeinput: list, affrangeinput: list, sitecrv: Curve, N: Int32
# ---------- python_2: Python ----------
#=================================#
#============Kanagawa==============#
#=======For Tokyo Studio=====#
#==========Written by Dugy========#
#===========Apr 18th 2017==========#
#==Do not use without permission==#
#=================================#
from math import *
import random
import Rhino.Geometry as rg
import Rhino.Geometry.Vector3d as PVector
import Rhino.Geometry.Point3d as Point 
import Rhino.Geometry.Curve as Curve
import Rhino.Geometry.Line as Line
import rhinoscriptsyntax as rs
import scriptcontext as sc
#=======================#
#Basic Functions
#=======================#
def toplimit(vct,speed):
	if vct.Length <= speed:
		pass
	else:
		vct.Unitize()
		vct = PVector.Multiply(vct,speed)
	return vct

def lowerlimit(vct,speed):
	if vct.Length >= speed:
		pass
	else:
		vct.Unitize()
		vct = PVector.Multiply(vct,speed)
	return vct
random.seed(7)
#=================================#
#Classes
#=================================#
class Eddy_config():
	"""config for Class Eddy """
	def __init__(self, loc_, gravity_, oricharge_, affrange_, id_):
		self.id = id_
		self.gravity = gravity_
		self.oricharge = oricharge_          # orient angle:  0 attract, 1 reject (0-pi)
		self.buffer = affrange_
		self.loc = loc_
class Eddy():
	"""provide gravity"""
	rangedemp = 0.5
	fieldcharge = 0.25
	boundaryZ = 30.0
	def __init__(self,config):
		self.config = config
		self.id = config.id 
		self.gravity = config.gravity
		self.oricharge = config.oricharge    # 0 attract   1  reject
		self.loc = config.loc
		self.buffer = config.buffer    #  buffer area
		self.core = self.rangedemp * self.buffer   #core area
class Flow_config(object):
	"""config for Class Flow """
	def __init__(self, loc_, vel_, acc_ ):
		self.loc = loc_
		self.vel = vel_
		self.acc = acc_
class Flow(object):
	"""vector field"""
	toplimit = 2.0
	lowerlimit = 2.0
	boundaryZ = 15.0
	def __init__(self, config):
		self.config = config
		self.loc = config.loc
		self.vel = config.vel
		self.acc = config.acc
		self.ptlist = [Point(self.loc)]
		self.trail = None
		self.target = PVector(0,0,0)
		self.orient = PVector(0,0,0)
	def inradius(self,eddy):
		dist = PVector.Subtract(self.loc,eddy.loc)
		dist2d = PVector(dist.X,dist.Y,0).Length
		if dist2d >= eddy.buffer: 
			return 0
		elif dist2d <= eddy.core:
			return -1
		else:
			return dist2d
	def getoricharge(self,eddies):
		ori = 0
		orisum = []
		for eddy in eddies:
			sts = self.inradius(eddy)
			if sts == 0:
				pass
			else:
				if sts == -1:
					ori = eddy.oricharge
				else:
					ori = (sts -eddy.core)/(eddy.buffer-eddy.core)*(eddy.oricharge-eddy.fieldcharge)+eddy.fieldcharge
				orisum.append(ori)
		if len(orisum) == 0:
			return Eddy.fieldcharge
		else:
			return sum(orisum)/len(orisum)
	def gettarget_2d(self,eddies):
		target_2d  = PVector(0,0,0)
		for i in range(len(eddies)):
			v = PVector.Subtract(eddies[i].loc,self.loc)
			v2d = PVector(v.X,v.Y,0)  # planer target
			dist2d = v2d.Length
			# compute the sum of the arraction vector / distance
			v2d.Unitize()
			v2d = PVector.Multiply(v2d, float(eddies[i].gravity/pow(dist2d,1.0)))
			# add vector to attraction vector collection
			target_2d = PVector.Add(target_2d,v2d)
			
		#Limit the target length
		target_2d = toplimit(target_2d,self.toplimit)   
		target_2d = lowerlimit(target_2d,self.lowerlimit)
		self.target = target_2d
		#print target_2d
	def getacc_z(self):
		acc_z = self.target.Length*0.05
		self.acc = PVector(0,0,acc_z)
		self.acc = toplimit(self.acc,toplimit)
	def getorient(self,eddies):
		orient_2d = self.target 
		angle = self.getoricharge(eddies)*pi
		orient_2d.Rotate(angle, PVector(0,0,1))
		self.orient = orient_2d 
	def boundarycheck(self):
		if self.loc.Z > self.boundaryZ or self.loc.Z < -0.2*self.boundaryZ:
			self.acc = -self.acc
		else:
			pass
	def getvel(self):
		#self.vel = PVector(0,0,self.vel.Z)   #refresh only keep the Z vel
		self.vel = PVector.Add(self.vel,self.orient)
		self.vel = toplimit(self.vel,self.toplimit)
		self.vel = PVector.Add(self.vel,self.acc)
	def update(self,eddies):
		self.gettarget_2d(eddies)
		self.getorient(eddies) 
		self.getacc_z()
		self.boundarycheck()
		self.getvel()
		self.loc = PVector.Add(self.loc,self.vel) 
	def drawtrial(self):
		self.ptlist.append(Point(self.loc))
		self.trail = Curve.CreateInterpolatedCurve(self.ptlist,3)
	def run(self,eddies):
		self.update(eddies)
		self.drawtrial()

#=================================#
#Parameters
#=================================#
n_eddys = 14
cellsize = 15
n_flow = 600
xlength = 300
ylength = 400
zlength = 10

#=================================#
#Collections
#=================================#
eddyconfig = []
flowconfig = []

eddycollection = []
flowcollection = []

pointcollection = []
#input eddies
for i in range(len(eddyinput)):
	loc = PVector(eddyinput[i].X,eddyinput[i].Y,eddyinput[i].Z)
	gravity = gravityinput[i]
	oricharge = orichargeinput[i]
	affrange = affrangeinput[i]

	eddyconfig.append(Eddy_config(loc,gravity,oricharge,affrange,i))
	eddycollection.append(Eddy(eddyconfig[i]))
	pointcollection.append(Point(Eddy(eddyconfig[i]).loc))
#generate flow particles
crv = sc.doc.Objects.AddCurve(sitecrv)
j = -1
for i in range(n_flow):
	u = random.uniform(0.0,1.0)
	v = random.uniform(0.0,1.0)
	a = sitesrf.PointAt(u,v)
	aaa = PVector(a.X,a.Y,a.Z)
	if rs.PointInPlanarClosedCurve(a,crv) == 0:
		pass
	else:
		flowconfig.append(Flow_config(aaa,PVector(0,0,0),PVector(0,0,0)))

for config in flowconfig:
	flowcollection.append(Flow(config))



#=================================#
#Draw
#=================================#
for i in range(N):
	for particle in flowcollection:
		particle.run(eddycollection)


#=================================#
#Storage Output
#=================================#

fieldcollection = []

for particle in flowcollection:
	fieldcollection.append(particle.trail)
# ---------- end python_2 ----------
crv_2 = Curve([<curve referenced from the Rhino model> x7])
number_slider = Slider(1000, range=0..1000)
cp = ControlPoints(Curve=crv_2)  # -> Points, Weights, Knots
branch = TreeBranch(Tree=cp.Points, Path="{0;3}", MaintainPaths=True)
lng = ListLength(List=cp.Weights)
crv_3 = Curve(python_2.fieldcollection)
pt_2 = Point(python_2.pointcollection)
crv_4 = Curve(python.fieldcollection)  # disabled
pt_3 = Point(python.pointcollection)  # disabled
lng_2 = ListLength(List=branch)
python_3 = PythonScript(N=number_slider, V=lng)  # -> out, flatten(i); inputs N: Int32, V: Int32
# ---------- python_3: Python ----------
ratio = N / 1000
i = int( ratio * V )
print i
# ---------- end python_3 ----------
python_4 = PythonScript(N=number_slider, V=lng_2)  # -> out, i; inputs N: Int32, V: Int32
# ---------- python_4: Python ----------
ratio = N / 500
i = int( ratio * V )
if i >= V:
    i = V
print i
# ---------- end python_4 ----------
preview = CustomPreview(
    Geometry=pt_2,
    Shader={ambient=RGB(128, 128, 128), diffuse=RGB(135, 206, 250), emission=RGB(76, 32, 54), shine=0.5, specular=RGB(255, 255, 255), transparency=0})
replace = ReplaceItems(List=python_3.i, Item=python_4.i, Indices=3, Wrap=False)  # -> graft(List)
split = SplitList(List=cp.Points, Index=replace)  # -> ListA, ListB
pt_4 = Point(simplify(split.ListA))
number_slider_2 = Slider(6, range=0..7)
nurbs = NurbsCurve(Vertices=split.ListA, Degree=3, Periodic=False)  # -> Curve, Length, Domain
flatten = FlattenTree(Tree=nurbs.Curve, Path="{0}")
item = ListItem(List=flatten, Index=number_slider_2, Wrap=True)
end = EndPoints(Curve=nurbs.Curve)  # -> Start, End
crv_5 = Curve(reparameterize(<curve referenced from the Rhino model>))
division = Division(A=number_slider, B="1000")
flatten_2 = FlattenTree(Tree=end.End, Path="{0}")
crv_6 = Curve(reparameterize(<curve referenced from the Rhino model>))
pt_5 = Point(end.End)
eval = EvaluateLength(Curve=crv_5, Length=division, Normalized=True)  # -> Point, Tangent, Parameter
eval_2 = EvaluateLength(Curve=crv_6, Length=division, Normalized=True)  # -> Point, Tangent, Parameter
item_2 = ListItem(List=flatten_2, Index=number_slider_2, Wrap=True)
preview_2 = CustomPreview(
    Geometry=pt_5,
    Shader={ambient=RGB(128, 128, 128), diffuse=RGB(135, 206, 250), emission=RGB(0, 128, 128), shine=0.5, specular=RGB(255, 255, 255), transparency=0})
Z = UnitZ(Factor=1)
syncfloundercamera = SyncFlounderCamera(Activate=Toggle(False), ViewportName="A-4", Location=eval.Point, Target=eval_2.Point, Lens=50, Up=Z)
